# Grasshopper definition cubicleMount.gh (Grasshopper 1.0.7)

extra_width = Slider(2.401, range=0..5)
facecutcrv = Curve(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)
pt = Point(Point(0, 0, 0))
bbox = BoundingBox(Content=facecutcrv, Plane=PlaneXY(0, 0, 0))  # -> Box, Box_2
debox = DeconstructBox(Box=bbox.Box)  # -> Plane, X, Y, Z
dedomain = DeconstructDomain(Domain=debox.X)  # -> Start, End
dedomain_2 = DeconstructDomain(Domain=debox.Y)  # -> Start, End
dedomain_3 = DeconstructDomain(Domain=debox.Z)  # -> Start, End
boundary = BoundarySurfaces(Edges=facecutcrv)
evalsrf = EvaluateSurface(Surface=reparameterize(boundary), Point="0.5, 0.5, 0")  # -> Point, Normal, UDirection, VDirection, Frame
subtraction = Subtraction(A=dedomain_3.Start, B=extra_width)
addition = Addition(A=dedomain_2.End, B=extra_width)
addition_2 = Addition(A=dedomain.End, B=extra_width)
pl = PlaneNormal(Origin=evalsrf.Point, ZAxis=evalsrf.Normal)
pt_2 = ConstructPoint(XCoordinate=addition_2, YCoordinate=addition, ZCoordinate=subtraction)
addition_3 = Addition(A=addition_2, B=addition, C=subtraction)
neg = Negative(Value=addition_3)
box = Box2Pt(PointA=pt, PointB=pt_2, Plane=PlaneXY(0, 0, 0))
dom = ConstructDomain(DomainStart=neg, DomainEnd=addition_3)
dom_2 = ConstructDomain(DomainStart=0, DomainEnd=addition_3)
box_2 = DomainBox(Base=pl, X=dom, Y=dom, Z=dom_2)
Z = UnitZ(Factor=subtraction)
X = UnitX(Factor=addition_2)
Y = UnitY(Factor=addition)
move = Move(Geometry=pt, Motion=Z)  # -> Geometry, Transform
sdiff = SolidDifference(BrepsA=box, BrepsB=box_2)
move_2 = Move(Geometry=pt, Motion=X)  # -> Geometry, Transform
move_3 = Move(Geometry=pt, Motion=Y)  # -> Geometry, Transform
ln = Line(StartPoint=pt, EndPoint=move.Geometry)
move_4 = Move(Geometry=ln, Motion=X)  # -> Geometry, Transform
ln_2 = Line(StartPoint=pt, EndPoint=move_2.Geometry)
ln_3 = Line(StartPoint=pt, EndPoint=move_3.Geometry)
merge = Merge(Data1=ln_2, Data2=ln_3, Data3=move_4.Geometry)
pipe = Pipe(Curve=merge, Radius=1, Caps=0)
shellify = Shellify()

# ==== cluster Shellify
object = ClusterInput()
object_2 = Data(object)
thickness = Slider(0.865, range=0..5)
debrep = DeconstructBrep(Brep=object_2)  # -> Faces, Edges, Vertices
volume = Volume(Geometry=object_2)  # -> Volume, Centroid
evalsrf = EvaluateSurface(Surface=reparameterize(debrep.Faces), Point="0.5, 0.5, 0")  # -> Point, graft(Normal), UDirection, VDirection, Frame
neg = Negative(Value=evalsrf.Normal)
area = Area(Geometry=debrep.Faces)  # -> Area, Centroid
merge = Merge(Data1=evalsrf.Normal, Data2=neg)  # -> simplify(Result)
multiplication = Multiplication(A=thickness, B=merge)
move = Move(Geometry=simplify(graft(area.Centroid)), Motion=multiplication)  # -> Geometry, Transform
dist = Distance(PointA=volume.Centroid, PointB=move.Geometry)  # -> simplify(Distance)
item = ListItem(List=dist, Index=0, Wrap=True)  # -> Item, Item1
larger = LargerThan(FirstNumber=item.Item, SecondNumber=item.Item1)  # -> LargerThan, OrEqualTo
int = Integer(larger.LargerThan)
item_2 = ListItem(List=multiplication, Index=int, Wrap=True)  # -> flatten(Item)
extr = Extrude(Base=debrep.Faces, Direction=item_2)
E = ClusterOutput(extr)
